% Simulink data dictionary Chain.sldd

ChainFrntSprktCrdnt = [0.05 -0.05]
ChainFrntSprktInert = 0.005
ChainFrntSprktRadius = 0.04
ChainRearSprktInert = 0.01
ChainRearSprktRadius = 0.12
ChainWhlDamperEqlbrmAng = -0.015
ChainRearSprktAngVel = 0
ChainRearWhlAngVel = 0
ChainWhlDamperDamp = 50
ChainWhlDamperStf = 5000