% Simulink data dictionary ElectricMachine1.sldd

PlntEM1TimeCnst = 0.02
PlntEM1ExtSplySerRes = 0
PlntEM1RotDamp = 0.001
PlntEM1RotInertia = 0.01
PlntEM1RotInitSpd = 0
PlntEM1Spd = [0 56.5225 113.045 169.5675 226.09 282.6124 308.295 339.1349 395.6574 452.1799 508.7024 565.2249 621.7474 678.2699]
PlntEM1Trq = [120 120 120 120 120 120 120 109.1 93.5 81.8 72.7 65.5 59.5 54.6]
PlntEM1TrqEff = [0 12 24 36 48 60 72 84 96 108 120]

PlntEM1EffTbl = [52 78 80 82 82 80 78 78 76 74 70
 52 78 80 82 82 80 78 78 76 74 70
 52 78 84 86 86 86 86 84 84 82 82
 52 80 86 86 88 88 88 86 86 84 84
 52 80 86 88 88 88 88 88 86 86 86
 52 80 86 88 90 90 90 90 88 88 88
 52 82 88 90 91 91 92 92 92 91 91
 52 82 88 91 91 92 93 93 93 93 93
 52 84 90 92 92 93 93 93 93 93 93
 62 86 91 93 93 93 93 93 93 93 93
 66 86 91 93 93 93 93 93 93 93 93
 70 86 92 93 93 93 93 93 93 93 93
 70 86 92 93 93 93 93 93 93 93 93
 72 86 91 93 93 93 93 93 93 93 93]

PlntEM1SpdEff = [0 56.5225 113.045 169.5675 226.09 282.6124 308.295 339.1349 395.6574 452.1799 508.7024 565.2249 621.7474 678.2699]
PlntEM1TrqLossTbl = repmat(0, 14, 11)
PlntEM1Ratio = 3