% Simulink data dictionary Environment.sldd

EnvAbsPrs = 101325
EnvGrvty = 9.81
EnvNomFrictionScaling = 1
EnvWindVelX = 0
EnvWindVelY = 0
EnvWindVelZ = 0
EnvNominalGrade = 0
EnvAirDen = 1.18
AeroMotoEffctArea = 2
AeroRltWindAngVect = [-1 1]
GasCnst = 287.058
AeroLongDrgCff = 0.2
AeroSideFrcCff = [0 0]
AeroLiftCff = 0.1
AeroPitchMomentCff = 0.1
AeroPitchMomentLngth = 2
AeroYawMomentCff = [0 0]
EnvAirTemp = 293.15