% Simulink data dictionary FuelCellElectricSystem.sldd

Bat = struct(
  DischrgLmt_bpt=[0 0.35 0.7 1 1 1 1 1 1 1 1],
  ChrgLmt_bpt=[1 1 1 1 1 1 1 1 0.7 0.35 0],
  SOC_bpt=[0 0.1 0.2 0.3 0.4 0.5 0.6 0.7 0.8 0.9 1],
  BattDischrgMax=110000,
  BattChrgMax=-110000,
  noLoadV=[201.6 201.6 201.6 201.6 201.6 201.6 201.6
   258.768 258.768 258.768 258.768 258.768 258.768 258.768
   264.96 264.96 264.96 264.96 264.96 264.96 264.96
   272.952 272.952 272.952 272.952 272.952 272.952 272.952
   286.128 286.128 286.128 286.128 286.128 286.128 286.128
   303.912 303.912 303.912 303.912 303.912 303.912 303.912],
  CapSOCBp=[0 0.2 0.4 0.6 0.8 1],
  BattTempBp=[243.1 253.1 263.1 273.1 283.1 298.1 313.1],
  CapLUTBp=[0 0.01 0.02 0.03 0.04 0.05 0.06 0.07 0.08 0.09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 1],
  Em=[2.8 3.228 3.284 3.361 3.408 3.427 3.472 3.477 3.493 3.504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 4.221],
  Ns=72,
  Np=2,
  BattChargeMax=5.3,
  BattCapInit=3.18,
  AH=repmat(5.3, 1, 7),
  initSOC=0.6,
  RInt=[0.008846 0.006389 0.004364 0.002031 0.001443 0.0005603 0.001028
   0.009319 0.006554 0.004101 0.002563 0.001825 0.0007192 0.001338
   0.009027 0.005553 0.00406 0.002532 0.001795 0.0006887 0.001
   0.00847 0.005525 0.003452 0.00246 0.001778 0.0007557 0.001536
   0.01032 0.006043 0.003846 0.002716 0.001924 0.0007355 0.001546
   0.01314 0.007805 0.004517 0.003047 0.002234 0.001014 0.002789],
  R0=[0.636912 0.460008 0.314208 0.146232 0.103896 0.0403416 0.074016
   0.670968 0.471888 0.295272 0.184536 0.1314 0.0517824 0.096336
   0.649944 0.399816 0.29232 0.182304 0.12924 0.0495864 0.072
   0.60984 0.3978 0.248544 0.17712 0.128016 0.0544104 0.110592
   0.74304 0.435096 0.276912 0.195552 0.138528 0.052956 0.111312
   0.94608 0.56196 0.325224 0.219384 0.160848 0.073008 0.200808],
  thermalMass=500)

BattDCDC = struct(
  Vout=650,
  Plim=60000,
  currMax=9230.769,
  eff=98,
  convLoss=1,
  tc=0.001,
  Vinit=650,
  thermalMass=500,
  Vdroop=0,
  avgSwitchResistance=0.001,
  diodeFwdVolt=0.8,
  diodeOnResistance=0.001,
  diodeOffConductance=1.0e-5,
  inductance=0.005,
  inductorSeriesResistance=0,
  capacitance=0.001,
  CapEffSeriesResistance=10)

Brk = struct(BrkPrsMax=5000000, mu_kinetic=0.35, mu_static=0.45, disk_abore=0.05, Rm=0.15, num_pads=2)

Cond = struct(
  Width=60,
  Height=40,
  Thickness=2,
  Area=2400,
  TubeDh=0.25,
  TubeArea=0.04908739,
  NTube=256,
  NPerRow=8,
  NRows=32,
  Spacing=1,
  TotFinArea=30720)

Cpl = struct(GearRatio=1, Friction=0.0001)
DH2 = 74
DH2O = 25
DO2 = 18
DRVctrl = struct(Ki=1, Kp=2)
Diff = struct(Ndiff=7.94, Inertia=0.5)
Driveshaft = struct(inertia=3)
Duct = struct(Length=5, Width=60, Height=40, Area=2400, Dh=48)

ElecThermal = struct(
  ctrl=struct(Kp=0.1, Ki=0.1),
  TM1=struct(mass=2, sh=910),
  Tank=struct(
    volume=0.001,
    area=0.005,
    heightVector=[0.01 0.01],
    areaVectorA1B1=[0.001 0.001],
    areaVectorA2B2=[7.853982e-05 7.853982e-05]),
  MassFlowSource=struct(area=7.853982e-05),
  TL=struct(bulkMod=2.1791, PressMin=0.01, PressMax=50, volumeFraction=0.1),
  LR1=struct(area=3.926991e-05, areaAB=7.853982e-05, cd=0.7, RN=12),
  P1=struct(
    length=1,
    area=7.853982e-05,
    diam=0.01,
    elevGain=0,
    eqLength=0.1,
    rough=1.5e-5,
    lamDarcyFrac=64,
    lamUpp=2000,
    turbLow=4000,
    lamNu=3.66),
  P2=struct(
    length=1,
    area=7.853982e-05,
    diam=0.01,
    elevGain=0,
    eqLength=0.1,
    rough=1.5e-5,
    lamDarcyFrac=64,
    lamUpp=2000,
    turbLow=4000,
    lamNu=3.66),
  P3=struct(
    length=1,
    area=7.853982e-05,
    diam=0.01,
    elevGain=0,
    eqLength=0.1,
    rough=1.5e-5,
    lamDarcyFrac=64,
    lamUpp=2000,
    turbLow=4000,
    lamNu=3.66))

FCDCDC = struct(
  Vout=650,
  Plim=60000,
  Vdroop=0,
  currMax=9230.769,
  eff=98,
  convLoss=1,
  tc=0.001,
  Vinit=650,
  thermalMass=500,
  conductance=1.0e-8,
  inductance=0.005,
  capacitance=0.001,
  diodeFwdVolt=0.8,
  diodeOnResistance=0.001,
  diodeOffConductance=1.0e-5,
  avgSwitchResistance=0.001,
  inductorSeriesResistance=0,
  CapEffSeriesResistance=10)

FCctrl = struct(maxPWR=128000, opLimit=0.4, minV=200, SOCtgt=60, tempTgt=80)

FTP72 = struct(
  time=[0; 0.001669663; 0.004897891; 0.00812612; 0.01; 0.01322255; 0.0164451; 0.01966765; 0.02; 0.02166177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 1372],
  SpdKph=[0; 0; 0; 0; 0; 0; 0; 0; 0; 0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 0])

FTP75 = struct(
  time=[0; 0.001669663; 0.004897891; 0.00812612; 0.01; 0.01322255; 0.0164451; 0.01966765; 0.02; 0.02166177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 2474],
  SpdKph=[0; 0; 0; 0; 0; 0; 0; 0; 0; 0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 0])

FinArea = 2
FinDensity = 4
H2_D = 74
H2_R = 4124.482
H2_T = [-56.55 -50 -40 -30 -20 -10 -5 -4 -3 -2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 350]
H2_h = [2783.66 2873.942 3012.626 3152.225 3292.625 3433.721 3504.502 3518.675 3532.854 3547.038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 8639.957]
H2_k = [142.8347 146.6022 152.2362 157.7326 163.0977 168.3386 170.9148 171.4266 171.9373 172.4469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 317.7161]
H2_mu = [7.13281 7.281926 7.50683 7.728602 7.947439 8.163521 8.27058 8.291915 8.313226 8.334511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 14.85559]

HWFET = struct(
  time=[0; 0.001669663; 0.004897891; 0.00812612; 0.01; 0.01322255; 0.0164451; 0.01966765; 0.02; 0.02166177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 765],
  SpdKph=[0; 0; 0; 0; 0; 0; 0; 0; 0; 0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 0])

Mot = struct(
  maxT=[335 335 335 335 335 269.7676 215.8141 179.8451 154.1529 134.8838 119.8967 107.9071],
  w_eff_bp=[0 1000 2000 3000 3221 4000 5000 6000 7000 8000 9000 10000],
  Tc_Mot=0.02,
  T_eff_bp=[0 23.92857 47.85714 71.78571 95.71429 119.6429 143.5714 167.5 191.4286 215.3571 239.2857 263.2143 287.1429 311.0714 335],
  efficiency_table=[85 85 85 85 85 85 85 85 85 85 85 85 85 85 85
   85 85 85 85 85 85 85 85 85 85 85 85 85 85 85
   85 85 90 90 90 90 90 90 90 90 88 88 88 88 88
   85 85 92 92 92 92 92 92 92 92 92 90 90 90 90
   85 85 92 92 93 93 93 93 92 92 92 90 90 90 90
   85 85 93 94 94 94 94 94 94 94 94 94 94 94 94
   85 85 93 94 94 95 95 95 95 95 95 95 95 95 95
   85 85 93 94 94 95 95 95 95 95 95 95 95 95 95
   85 85 93 94 95 95 95 95 95 95 95 95 95 95 95
   85 85 93 94 95 95 95 95 95 95 95 95 95 95 95
   85 85 93 94 94 94 94 94 94 94 94 94 94 94 94
   85 85 90 92 93 93 93 93 93 93 93 93 93 93 93],
  supplyRes=0,
  inertia=5.0e-6,
  damping=0,
  thermalMass=800,
  winding=struct(area=250.2, thick=1, cond=401, mass=5, sh=385),
  windingIron=struct(area=250, thick=1, cond=360, mass=5, sh=447),
  ironStack=struct(area=4350, thick=1, cond=80.2, mass=5, sh=903))

N2_R = 296.8021
N2_T = [-56.55 -50 -40 -30 -20 -10 -5 -4 -3 -2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 350]
N2_h = [224.312 231.141 241.5641 251.9843 262.4022 272.8183 278.0258 279.0672 280.1087 281.1501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 651.9287]
N2_k = [19.62965 20.15333 20.94362 21.72315 22.49231 23.25148 23.62744 23.70235 23.77716 23.85188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 46.13228]
N2_mu = [13.79489 14.13672 14.65135 15.15754 15.65562 16.1459 16.38822 16.43646 16.48463 16.53272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 30.35133]
NFin = 7680
O2_D = 18
O2_R = 259.8366
O2_T = [-56.55 -50 -40 -30 -20 -10 -5 -4 -3 -2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 350]
O2_h = [196.314 202.3024 211.4456 220.5909 229.7402 238.8953 243.4756 244.3919 245.3083 246.2248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 583.4258]
O2_k = [19.6662 20.22248 21.06452 21.89803 22.72325 23.54041 23.94605 24.02694 24.10776 24.1885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 49.14745]
O2_mu = [15.76656 16.17276 16.78492 17.38773 17.98152 18.56661 18.85598 18.91361 18.97116 19.02862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 35.66104]
PTctrl = struct(RegenBrkCutOff=[0 1], RegenBrkSpd_bpt=[5 9])
Pipe = struct(Length=750, Dh=1.5, Area=1.767146)
Pump = struct(Speed=4000, Displacement=40)
RH2 = 4124.483
RH2O = 461.5231
RH_a = 0.6
RH_c = 0.6
RN2 = 296.8022
RO2 = 259.8367
RelayVariant = 1
ScenarioIndex = 5
Sig = Simulink.Signal()
SimEndTime = 2474
T_cell = 80
T_env = 20
T_ext = 30
T_init = 303.15
Tank = struct(Volume=10, Area=625, WallArea=2850)
Tire = struct(Inertia=0.2, Rated_Vertical_Load=3000, Rated_Peak_Long_Force=3500, Slip_At_Peak_Force=6, Radius=0.3)
Tvec = [-50 -40 -30 -20 -10 0 10 20 30 40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 350]

US06 = struct(
  time=[0; 0.001669663; 0.004897891; 0.00812612; 0.01; 0.01322255; 0.0164451; 0.01966765; 0.02; 0.02166177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 600],
  SpdKph=[0; 0; 0; 0; 0; 0; 0; 0; 0; 0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 0])

UrbanCycle1 = struct(
  time=[0; 1; 2; 3; 4; 5; 6; 7; 8; 9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 195],
  SpdKph=[0; 0; 0; 0; 0; 0; 0; 0; 0; 0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 0])

UrbanCycle2 = struct(
  SpdKph=[0; 0; 0; 0; 0; 0; 0; 0; 0; 0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 0],
  time=[0; 1; 2; 3; 4; 5; 6; 7; 8; 9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 400])

UrbanCycle3 = struct(
  time=[0; 1; 2; 3; 4; 5; 6; 7; 8; 9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 400],
  SpdKph=[0; 0; 0; 0; 0; 0; 0; 0; 0; 0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 0])

UrbanCycle4 = struct(
  time=[0; 1; 2; 3; 4; 5; 6; 7; 8; 9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 506],
  SpdKph=[0; 0; 0; 0; 0; 0; 0; 0; 0; 0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 0])

UrbanCycle5 = struct(
  time=[0; 1; 2; 3; 4; 5; 6; 7; 8; 9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 660],
  SpdKph=[0; 0; 0; 0; 0; 0; 0; 0; 0; 0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 0])

Vehicle = struct(
  Mass=1800,
  Distance_CG_FrontAxle=1.35,
  Distance_CG_RearAxle=1.35,
  Distance_CG_Ground=0.5,
  Frontal_Area=2.16,
  Aero_Drag_Coeff=0.26)

WOT = struct(
  time=[0; 0.001669663; 0.004897891; 0.00812612; 0.01; 0.01322255; 0.0164451; 0.01966765; 0.02; 0.02166177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 30],
  SpdKph=[0; 0; 0; 0; 0; 0; 0; 0; 0; 0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 0])

anode_tube_D = 0.01
cathode_tube_D = 0.05
comp_mdot_corr_TLU = [0 0.2 0.4; 0 0.15 0.3; 0 0.1 0.2; 0 0.05 0.1; 0 0 0]
comp_p_ratio_TLU = [1; 1.25; 1.5; 1.75; 2]
comp_rpm_TLU = [0 1800 3600]
coolant_num_layers = 20
coolant_num_passes = 12
coolant_tube_D = 0.05
coolant_w_channels = 1
drive_cycle_power = [0; 0; 0; 0; 0; 0; 0; 0; 0; 0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 45.47549]
drive_cycle_time = [0; 3.155444e-30; 0.004673064; 0.004673064; 0.022917; 0.022917; 0.04116093; 0.05940487; 0.09589273; 0.1688685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 2500]
env_RH = 0.5
env_T = 20
env_p = 0.101325
env_yO2 = 0.21

f_fc_auxpower = [551.8737 541.3677 545.779 545.6275 541.7314 545.318 554.7587 578.7361 578.5322 560.8061 536.1829
 546.0853 540.5963 552.9936 556.9689 552.0377 551.8292 563.6663 578.3266 578.3442 563.2498 545.4982
 528.4846 536.9077 561.6809 572.0575 565.9773 559.2702 563.7611 574.1201 575.1539 562.7322 552.5497
 513.1736 529.0817 560.481 573.8496 566.2711 555.2279 555.6293 564.609 567.2758 557.7008 555.7343
 503.303 520.9836 553.7505 566.9884 557.6713 544.3663 543.587 553.4628 558.7549 552.0736 551.6957
 502.7535 517.9214 547.9812 558.7272 547.6789 533.9264 534.1985 546.3008 554.1687 549.4437 549.7709
 515.0212 525.1727 550.0213 556.9426 544.4718 531.6938 534.3893 549.0258 558.487 554.0512 553.652
 542.265 546.6452 565.3892 568.2089 554.8871 544.0366 549.648 566.2429 575.7108 569.6233 566.9732
 584.7517 583.995 597.0845 596.3952 582.9459 574.4922 582.7603 600.1564 607.8982 598.479 592.4669
 640.8165 636.3875 645.145 642.0821 629.2324 623.2084 633.3545 650.1923 654.7909 641.0915 631.4365
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 ]

f_fc_currcmd_bpt = [0.209765 5.200602 10.19144 15.18228 20.17311 25.16395 30.15479 35.14562 40.13646 45.1273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 389.49504]

f_fc_h2flow = [8.715936e-08 -2.57884e-07 -4.849821e-07 -5.913394e-07 -5.729938e-07 -3.870643e-07 3.917198e-07 2.088573e-07 -1.287719e-07 7.086014e-08 -4.609277e-07
 2.112088e-05 2.074582e-05 2.045952e-05 2.026574e-05 2.016861e-05 2.017255e-05 2.028233e-05 2.050297e-05 2.031225e-05 2.054827e-05 2.008976e-05
 4.218026e-05 4.175682e-05 4.139423e-05 4.109619e-05 4.086678e-05 4.071048e-05 4.063216e-05 4.063702e-05 4.073059e-05 4.091872e-05 4.062869e-05
 6.331561e-05 6.28816e-05 6.24837e-05 6.212545e-05 6.181088e-05 6.154445e-05 6.133104e-05 6.117596e-05 6.108488e-05 6.106383e-05 6.111918e-05
 8.447334e-05 8.405935e-05 8.365991e-05 8.327843e-05 8.29188e-05 8.258541e-05 8.228311e-05 8.201722e-05 8.179348e-05 8.161802e-05 8.149737e-05
 0.0001056149 0.0001052443 0.0001048699 0.000104495 0.0001041233 0.000103759 0.000103407 0.0001030724 0.0001027611 0.0001024791 0.0001022332
 0.000126715 0.0001264043 0.0001260747 0.0001257292 0.0001253713 0.0001250052 0.0001246355 0.0001242673 0.0001239064 0.0001235589 0.0001232313
 0.00014776 0.0001475194 0.0001472477 0.0001469477 0.0001466229 0.0001462772 0.000145915 0.0001455414 0.000145162 0.0001447828 0.0001444104
 0.0001687458 0.0001685795 0.0001683729 0.0001681286 0.0001678499 0.0001675404 0.0001672046 0.0001668472 0.0001664737 0.0001660901 0.0001657027
 0.0001896757 0.000189583 0.0001894435 0.0001892596 0.0001890344 0.0001887713 0.0001884746 0.000188149 0.0001877996 0.0001874324 0.0001870534
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 ]

f_fc_heatflow = [-113.5086 -259.2992 -90.06723 -1.464342 -88.25963 -165.8424 6.193174 226.564 176.3037 17.34879 -332.1273
 315.6829 139.551 297.054 374.7538 292.6749 214.3488 306.2656 541.2652 526.9634 402.5653 132.6272
 683.8309 520.1967 646.8024 709.4127 647.071 589.3171 649.4849 784.915 839.3561 735.764 587.5422
 1077.332 927.3692 1034.746 1086.736 1036.675 992.2564 1031.679 1102.254 1085.682 977.0085 1028.244
 1492.749 1354.691 1452.963 1498.712 1454.458 1417.477 1447.978 1487.898 1438.046 1329.652 1445.061
 1928.283 1798.105 1895.666 1939.23 1895.194 1860.547 1893.069 1933.261 1883.09 1776.253 1895.765
 2383.109 2255.347 2358.82 2403.77 2355.198 2318.223 2361.62 2427.836 2404.167 2297.1 2364.365
 2856.862 2725.454 2839.768 2889.094 2832.058 2788.372 2848.769 2960.628 2983.816 2873.351 2840.356
 3349.285 3208.34 3336.878 3392.947 3324.351 3269.865 3350.548 3521.466 3605.983 3489.623 3320.69
 3860.053 3704.474 3849.258 3913.797 3831.377 3762.423 3864.163 4102.003 4257.681 4135.681 3810.403
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 ]

f_fc_tmpcmd_bpt = [50 55 60 65 70 75 80 85 90 95 100]

f_fc_voltage = [454.9926 452.1198 449.5574 449.4474 452.5471 457.9954 465.194 465.2974 460.8249 455.112 448.7809
 449.9262 447.096 444.3855 443.8345 446.2189 450.6363 454.973 456.9862 453.8009 449.1582 443.749
 444.442 441.9387 439.1633 438.1116 439.6141 442.9277 446.2311 447.7072 446.5134 443.0544 438.9602
 439.4138 437.324 434.6131 433.2474 434.0902 436.4976 438.862 439.7317 438.7199 436.5969 434.5773
 434.8296 433.2114 430.6635 429.1411 429.5248 431.2139 432.7372 432.9444 431.888 430.7455 430.8732
 430.669 429.5539 427.2366 425.6845 425.7854 426.9312 427.7126 427.2153 425.9078 425.4089 427.2944
 426.9049 426.3 424.2522 422.767 422.7353 423.4976 423.6357 422.4055 420.6634 420.4948 423.7659
 423.5053 423.3966 421.6307 420.2802 420.2396 420.7608 420.3518 418.3737 416.0379 415.9142 420.2211
 420.4346 420.7906 419.2965 418.1217 418.1696 418.5737 417.7095 414.9811 411.9184 411.5849 416.6045
 417.6552 418.4313 417.1804 416.1984 416.4074 416.7994 415.5665 412.0967 408.1998 407.4342 412.8731
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 ]

hH2 = [2873942 3012626 3152225 3292625 3433721 3575423 3717647 3860322 4003383 4146774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 8639957]
hH2O = [2407979 2426599 2445220 2463840 2482460 2501080 2520041 2538662 2557305 2575974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 3177425]
hN2 = [231141 241564.1 251984.3 262402.2 272818.3 283233 293646.8 304060.2 314473.7 324887.9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 651928.7]
hO2 = [202302.4 211445.6 220590.9 229740.2 238895.3 248058.1 257230.2 266413.5 275609.9 284821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 583425.8]
hvH2O = [2837864 2838667 2838714 2838009 2836579 2834477 2477187 2453519 2429811 2405977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 892746.8]
kH2 = [0.1466021 0.1522361 0.1577324 0.1630975 0.1683385 0.1734626 0.1784772 0.1833894 0.1882063 0.1929344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 0.3177159]
kH2O = [0.01339933 0.01407273 0.01474613 0.01541952 0.01609292 0.01676632 0.01741645 0.01808985 0.01878352 0.01949684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 0.04886504]
kN2 = [0.02015333 0.02094362 0.02172315 0.02249231 0.02325148 0.02400104 0.02474133 0.02547268 0.02619543 0.02690989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 0.04613228]
kO2 = [0.02022248 0.02106452 0.02189803 0.02272325 0.02354041 0.02434976 0.02515152 0.02594593 0.0267332 0.02751354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 0.04914745]
muH2 = [7.281926e-06 7.506831e-06 7.728602e-06 7.94744e-06 8.163522e-06 8.377009e-06 8.588047e-06 8.796769e-06 9.003294e-06 9.207733e-06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 1.485559e-05]
muH2O = [7.407548e-06 7.715705e-06 8.023862e-06 8.332018e-06 8.640175e-06 8.948332e-06 9.242316e-06 9.550473e-06 9.870319e-06 1.020034e-05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 2.238905e-05]
muN2 = [1.413672e-05 1.465135e-05 1.515754e-05 1.565562e-05 1.61459e-05 1.662869e-05 1.710428e-05 1.757293e-05 1.803491e-05 1.849046e-05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 3.035133e-05]
muO2 = [1.617276e-05 1.678492e-05 1.738773e-05 1.798152e-05 1.856661e-05 1.91433e-05 1.97119e-05 2.027267e-05 2.082589e-05 2.137181e-05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 3.566104e-05]
pH2O = [0.003937693 0.01284113 0.03800501 0.1032387 0.2598729 0.6111514 1.228199 2.339318 4.246971 7.384938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 16529.42]
p_a = 0.101325
p_c = 0.101325
p_sat = 0.04741447
p_sat_c = 0.04741447
p_sat_e = 0.002339318
radiator_H = 0.5
radiator_L = 1
radiator_N_fins = 12000
radiator_N_tubes = 25
radiator_W = 0.025
radiator_air_area_fins = 11.5625
radiator_air_area_primary = 1.223125
radiator_cp = 910
radiator_eta_fin = 0.7
radiator_fin_spacing = 0.002
radiator_gap_H = 0.01927083
radiator_rho = 2700
radiator_t_wall = 0.0001
radiator_tube_H = 0.0015
radiator_tube_Leq = 2.5
stack_alpha = 0.7
stack_area = 280
stack_iL = 1.4
stack_io = 0.0001
stack_mea_cp = 870
stack_mea_rho = 1800
stack_num_cells = 400
stack_num_channels = 8
stack_t_gdl = 250
stack_t_membrane = 125
stack_w_channels = 1
tank_V = 120
tank_p = 70
tank_yH2 = 0.9997
y_H2O_a = 0.2807667
y_H2O_c = 0.01385237
y_H2_a = 0.7192333
y_N2_a = 0
y_N2_c = 0.7761476
y_O2_c = 0.21
BattChrgMax = -110000
BattDischrgMax = 110000
BrkPrsMax = 5000000
ChrgLmt_bpt = [1 1 1 1 1 1 1 1 0.7 0.35 0]
DischrgLmt_bpt = [0 0.35 0.7 1 1 1 1 1 1 1 1]
FCctrlCopy = struct(maxPWR=128000, opLimit=0.4, minV=200, SOCtgt=60, tempTgt=80)
RegenBrkCutOff = [0 1]
RegenBrkSpd_bpt = [5 9]
SOC_bpt = [0 10 20 30 40 50 60 70 80 90 100]
T_eff_bpCopy = [0 23.92857 47.85714 71.78571 95.71429 119.6429 143.5714 167.5 191.4286 215.3571 239.2857 263.2143 287.1429 311.0714 335]