% Simulink data dictionary Moto.sldd

MotoFrntSuspStf = 25000
MotoFrntSuspDamp = 1250
MotoFrntSuspEqlbrmLngth = 0.473
MotoRearSuspStf = 1500
MotoRearSuspDamp = 150
MotoRearSuspEqlbrmLngth = 0
MotoStrDamp = 10
MotoGrvty = 9.80665
MotoRollOfst = 0
MotoPtchOfst = 0
MotoYawOfst = 0
MotoLongOfst = 0
MotoLatOfst = 0
MotoVertOfst = 0
MotoStrgOfst = 0
g = 9.8
MotoFrmCm = [0.255 0 -0.02]
MotoFrmMass = 223
MotoFrmInert = [24.5 26.2 30.3]
MotoFrmLngth = 0.73
MotoUpprFrntFrkPos = [0.023 0 -0.098]
MotoUpprFrntFrkMass = 8.8
MotoUpprFrntFrkInert = [0 0.14 0]
MotoUpprFrntFrkOfst = 0.034
MotoLowrFrntFrkPos = [-0.029 0 -0.189]
MotoLowrFrntFrkMass = 7
MotoLowrFrntFrkInert = [0 0.18 0]
MotoRearArmPos = [0.275 0 -0.052]
MotoRearArmMass = 10
MotoRearArmInert = [0 0.8 0]
MotoRearArmLngth = 0.535