% Simulink data dictionary MotoInit.sldd

InitRearCntctPtchX = 0
InitRearCntctPtchY = 0
InitRollAng = 0
InitYawAng = 0
InitStrAng = 0
InitRearCntctPtchLatVel = 0
InitRearCntctPtchVertVel = 0
InitRearArmPitchRate = 0
InitMainFrmPitchRate = 0
InitRollRate = 0
InitYawRate = 0
InitStrRate = 0
InitLwrFrkDerfmVel = 0
InitUnrealEngXPos = -118
InitUnrealEngYPos = 0
InitUnrealEngRollAng = 0
InitUnrealEngZPos = 0
InitUnrealEngPtchAng = 0
InitUnrealEngYawPos = 0
PlntVehInitLongVel = 0
PlntVehInitLatVel = 0
PlntVehInitVertVel = 0
PlntVehInitRollRate = 0
PlntVehInitPitchRate = 0
PlntVehInitYawRate = 0
PlntVehInitLongPos = 0
PlntVehInitRollAng = 0
PlntVehInitPitchAng = 0
PlntVehInitYawAng = 0
PlntVehInitVertPos = 0
InitRearSprktAngVel = 0
InitRearCntctPtchZ = 0.04367272
InitRearArmPitchAng = -0.02138059
InitMainFrmPitchAng = 0.5749128
InitFrkLngth = 0.4227581
PlntVehInitLatPos = 0
InitRearCntctPtchLongVel = 0