% Simulink data dictionary MotoScenario.sldd

XGate = 35
t_start = 3
xdot_r = 30
vehW = 2
latoff = 0
latRefbp = [0 2 12 25.5 36.5 49 61]
latRef = [0 0 -0.75 -3.5 -2.5 0 0]
X_o = 0
Y_o = 0
Z_o = 0
phi_o = 0
psi_o = 0
theta_o = 0
omega_hwHandwheel_rate = 13.5
theta_max = 90
t_stop = 60
ay_max = 0.5
t_sweep = 30
theta_hw = 90
theta_hw_final = 0.7
steerF = 0.7
steerA = 90
tdwell = 0.5
R = 100
cr_ay_max = 0.5
ScnUnrealEngFrmRate = 0.03
ScnCRLatAccStop = "off"
ScnCRMaxLatAccel = 0.5
ScnCRRadius = 100
ScnDLCGateLongPos = 175
ScnDLCLatRef = [0 0 -5 -3.875 -3.5 1 0 0 0]
ScnDLCLatRefOffset = 5.7
ScnDLCLongRefBpt = [0 5.875 6 18 33 33.5 45 50 60]
ScnDLCLongRefStartPos = 2
ScnDLCVehicleWidth = 2
ScnFHCounterDwellTime = 3
ScnFHInitialDwellTime = 0.5
ScnFHReturnTime = 2
ScnFHRollRateZeroCross = 1.5
ScnFHSteerSpeed = 720
ScnFHUseRollRate = "off"
ScnISHandwheelRate = 13.5
ScnISLatAccStop = "on"
ScnISMaxHandwheelAng = 270
ScnISMaxLatAccel = 0.5
ScnISSteerHoldTime = 2
ScnLongVelUnit = "mph"
ScnManType = 1
ScnSDDwellTime = 0.5
ScnSDSteerAmp = 90
ScnSDSteerFreq = 0.7
ScnSSFinalFreq = 0.7
ScnSSSteerAmp = 90
ScnSSSweepTime = 30
ScnSteerDir = "off"
ScnStrgAngTbl = repmat(0, 1, 301)
ScnTrqTbl = repmat(0, 1, 301)
ScnFHSteerAmp = 540
ScnTimeBpts = [0 0.05 0.1 0.15 0.2 0.25 0.3 0.35 0.4 0.45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 15]
ScnStrgTrqTbl = [0 0 0 0 0 0 0 0 0 0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 5]
ScnOvalTrackr = 15
ScnOvalTrackl = 80
ScnOvalTrackpdst = 1
ScnUDTrackCoordX = [0; 0.01; 0.02; 0.03; 0.04; 0.05; 0.06; 0.07; 0.08; 0.09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 100]
ScnUDTrackCoordY = [0; 0.005; 0.01; 0.015; 0.02; 0.025; 0.03; 0.035; 0.04; 0.045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 50]
ScnUDTrackMATFile = "Traj.mat"
ScnUDTrackCSVFile = "Traj.csv"
ScnBrakePedalTime = 20
ScnAccTbl = repmat(0.1, 1, 301)
ScnBrkTbl = repmat(0, 1, 301)
ScnLongPosBpts = [0 0.3333333 0.6666667 1 1.333333 1.666667 2 2.333333 2.666667 3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 100]
ScnSimTime = 40
ScnStartTime = 2
ScnTimeToStrtDecel = 10
ScnLongVelRef = 40