% Simulink data dictionary Rider.sldd

RiderCmLoct = [0.275 0 -0.61]
RiderMass = 78
RiderInert = [6.4 6.4 6.4]
DriverAeroRes = 0.5
DriverDrivelineRes = 2.5
DriverInitialGear = 0
DriverShiftTime = 0.1
DriverWheelRange = 1.047198
DriverPositionGainF = 1
DriverPositionGainR = 0.25
DriverYawRateGain = 0.01
DriverDelayGain = 0.01
DriverRollRes = 100
RiderLkAhdPtDstGain = 1.7
RiderTrgtRollAngGain = 0.11
RiderTrgtTrajGain = -21.5
RiderPrevTipOvrGain = 9
RiderFrstOdrTimeCnst = 0.1
RiderOpDeadTime = 0.1
DriverTimeConst = 0.3
DriverFrontCornerStiff = 40000
DriverRearCornerStiff = 40000
DriverTractiveForce = 8000
DriverPreviewDist = 6