% Simulink data dictionary SimpleEngine.sldd

PlntEngLhv = Simulink.Parameter(46000000, DataType="double")
PlntEngSg = Simulink.Parameter(0.754)
PlntEngBsfcAvg = Simulink.Parameter(350)
PlntEngTqMot = Simulink.Parameter([0 8 10 14 18 22 24 27 34])
PlntEngTqMotBpt = Simulink.Parameter([0 500 1000 2000 3000 4000 4500 5000 6000])
PlntEngTqMaxFric = Simulink.Parameter([0 4 5.2 8 10.5 13 14 15 17])
PlntEngFuelSpdVec = Simulink.Parameter([1000 6000])
PlntEngFuelTrqVec = Simulink.Parameter([0 400])
PlntEngSpdThresh = Simulink.Parameter(100)
PlntEngTqMaxBpt = Simulink.Parameter([0 849.1535 1193.344 1536.402 1880.592 2223.65 2567.84 2910.898 3255.088 3599.279 3942.337 4286.527 4629.585 4973.775 5316.833 5661.023 6793.228 7925.433], DataType="double")
PlntEngTqMax = Simulink.Parameter([39.56258 39.56243 54.0664 64.73045 68.52476 71.36402 72.67633 73.61898 75.33956 77.94214 77.85097 78.85415 75.58328 71.9986 70.86535 69.35463 57.21757 48.54824], DataType="double")